# Grasshopper definition recursive.gh (Grasshopper 1.0.4)
# plug-ins: FirstComponentTest, Kangaroo2 Components

# ---- group: Sphere&Axis
Z = UnitZ(Factor=1)
xy = XYPlane(Origin=Point(0, 0, 0))
line = LineSDL(Start=xy, Direction=Z, Length=Slider(5, range=0..100))
msphereex = MeshSphereEx(Base=PlaneXY(0, 0, 0), Radius=10, Count=Slider(5, range=0..100))

# ----
sph = Sphere(Base=PlaneXY(0, 0, 0), Radius=1)
tapperfactor = Panel("1")

# ---- group: ScaleTaper(EggGenerate)
scale_nu = ScaleNU(Geometry=msphereex, Plane=PlaneXY(0, 0, 0), ScaleX=1, ScaleY=1, ScaleZ=Slider(1.5, range=0..10))  # -> Geometry, Transform
taper = Taper(
    Geometry=scale_nu.Geometry,
    Axis=line,
    Start=tapperfactor,
    End=Slider(0.9, range=0..10),
    Flat=False,
    Infinite=True,
    Rigid=False)

# ---- group: Get Z and Move
bbox = BoundingBox(Content=taper, Plane=PlaneXY(0, 0, 0))  # -> Box, Box_2
debox = DeconstructBox(Box=bbox.Box)  # -> Plane, X, Y, Z
num = Number(debox.Z)
Z_2 = UnitZ(Factor=num)  # -> expr("x/2", UnitVector)
move = Move(Geometry=taper, Motion=Z_2)  # -> Geometry, Transform

# ----
demesh = DeconstructMesh(Mesh=move.Geometry)  # -> Vertices, Faces, Colours, Normals; disabled
facen = FaceNormals(Mesh=move.Geometry)  # -> Centers, Normals; disabled
pdecon = Deconstruct(Point=facen.Centers)  # -> XComponent, YComponent, ZComponent; disabled
number_slider = Slider(4.4, range=0..10)  # disabled
number_slider_2 = Slider(0.1, range=0..1)  # disabled
num_2 = Number(pdecon.ZComponent)  # disabled
expression = Expression(x=number_slider_2, y=number_slider, z=num_2, Expression="if((x<z)and(z<y),1,0)")  # disabled
dispatch = Dispatch(List=demesh.Faces, DispatchPattern=expression)  # -> ListA, ListB; disabled
mesh_faces_aggregation = MeshFacesAggregation(Mesh=move.Geometry, Displacement=Slider(1, range=0..1), Iter=Slider(1, range=0..10))
swatch = ColourSwatch(SwatchColor=RGB(133, 133, 133))
conmesh = ConstructMesh(Vertices=demesh.Vertices, Faces=dispatch.ListA)  # disabled
conmesh_2 = ConstructMesh(Vertices=demesh.Vertices, Faces=dispatch.ListB)  # disabled
clean = CombineClean(Meshes=conmesh_2)  # disabled
preview = CustomPreview(Geometry=mesh_faces_aggregation, Material=swatch)
mesh = Mesh([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])  # disabled
preview_2 = CustomPreview(Geometry=mesh, Material=swatch)  # disabled
