# Grasshopper definition ripple.gh (Grasshopper 1.0.4)
# plug-ins: Human, FirstComponentTest, Weaverbird, Kangaroo2 Components

number_slider = Slider(15, range=1..15)
graph = GraphMapper(
    Slider(1, range=0..1),
    x0=0,
    x1=1,
    y0=0,
    y1=1,
    container_name="Bezier",
    cpx=[0, 0.1685691178, 0.7071095109, 1],
    cpy=[0, 0.9934671521, 0.5756947994, 0.947512269])
md_slider = MDSlider(slider_value=Point(0.5, 0.5, 0.5), SliderMode=0, x_domain=Domain(0, 1), y_domain=Domain(0, 1), z_domain=Domain(0, 1))
number_slider_2 = Slider(3, range=0..10)
remap = RemapNumbers(Value=graph, Source=Domain(0, 1), Target=Domain(15, 1))  # -> Mapped, Clipped
number_slider_3 = Slider(0.001, range=0..0.001)
number_slider_4 = Slider(1e-06, range=0..1e-06)
series = Series(Start=Slider(5, range=0..10), Step=1, Count=number_slider_2)
series_2 = Series(Start=0, Step=1, Count=number_slider_2)
msphere = MeshSphere(Base=PlaneXY(0, 0, 0), Radius=Slider(55, range=0..100), UCount=10, VCount=20)
scale = Scale(Geometry=msphere, Center=Point(0, 0, 0), Factor=remap.Mapped)  # -> Geometry, Transform
number_slider_5 = Slider(1, range=0..10)
pt = ConstructPoint(XCoordinate=series, YCoordinate=series_2, ZCoordinate=0)
clean = CombineClean(Meshes=msphere)
pop3d = Populate3D(Region=scale.Geometry, Count=Slider(10, range=0..10), Seed=Slider(3341865.078, range=0..10000000))
number_slider_6 = Slider(3, range=0..10)
pt_2 = Point(Point(50, 32, 0))
meshcp = MeshClosestPoint(Point=md_slider, Mesh=msphere)  # -> Point, Index, Parameter
wbloop = WeaverbirdsLoopSubdivision(MeshCurves=msphere, Level=number_slider_6, SmoothNakedEdges=1)
wbloop_2 = WeaverbirdsLoopSubdivision(MeshCurves=wbloop, Level=number_slider_6, SmoothNakedEdges=1)
meshrip = MeshRipple(Mesh=wbloop, AttractorPoints=pop3d, DispDistance=Slider(0.3, range=0..1), Iterations=Slider(43, range=0..100))  # -> Mesh, DispValues, P
mattable = MaterialTable(Update=True)  # -> MaterialName, Shader, Diffuse, Specular, Emission, Alpha, Gloss
demesh = DeconstructMesh(Mesh=[wbloop, meshrip.Mesh])  # -> Vertices, Faces, Colours, Normals
mesh = Mesh(meshrip.Mesh)
flip = FlipMatrix(Data=simplify(demesh.Vertices))
item = ListItem(List=flip, Index=0, Wrap=True)  # -> Item, Item1
preview = CustomPreview(
    Geometry=mesh,
    Material={diffuse=RGB(105, 105, 105), emission=RGB(0, 0, 0), shine=1, specular=RGB(255, 255, 255), transparency=0})
dist = Distance(PointA=item.Item, PointB=item.Item1)  # -> flatten(Distance)
panel = Panel(meshrip.DispValues)
